# Grasshopper definition FibonacciSeries.gh (Grasshopper 1.0.7)
# plug-ins: Human

number_slider = Slider(0.657, range=0.001..0.99)
number_slider_2 = Slider(0.64, range=0.001..0.99)
p = Slider(1, range=0.1..1)
python = GhPythonScript(a=number_slider, b=number_slider)  # -> out, crvs, lines
# ---------- python: Python ----------
import rhinoscriptsyntax as rs
from math import sin, cos, pi, e

# coordinates
cor = []

for i in range(0,41):
    teta = i*pi/20
    x = a * cos(teta) * (e**(b*teta))
    y = a * sin(teta) * (e**(b*teta))
    z = 20*sin(teta/2.5)
    cor.append([x,y,z])

all_pts = []
crvs = []
for i in range(24):
    teta = i*pi/12
    pts = []
    for j in cor:
        x = (j[0]-cor[0][0])*cos(teta) - (j[1]-cor[0][1])*sin(teta) + cor[0][0]
        y = (j[0]-cor[0][0])*sin(teta) + (j[1]-cor[0][1])*cos(teta) + cor[0][1]
        pts.append(rs.AddPoint(x,y,j[2]))
    crvs.append(rs.AddInterpCurve(pts))
    all_pts.append(pts)

lines = []

for i in range(-1,23):
    pts1 = all_pts[i][1:]
    pts2 = all_pts[i+1][:-1]
    
    for j in range(len(pts1)):
        lines.append(rs.AddLine(pts1[j],pts2[j]))
# ---------- end python ----------
python_2 = GhPythonScript(
    a=number_slider_2,
    b=number_slider_2,
    n=Slider(50, range=10..50),
    m=Slider(0.526, range=-3..3),
    t=Slider(30, range=5..30),
    u=Slider(5.07, range=1..10),
    v=Slider(24, range=6..24),
    p=p)  # -> out, surfaces
# ---------- python_2: Python ----------
import rhinoscriptsyntax as rs
from math import sin, cos, pi, e

# coordinates
cor = []

for i in range(0,int(n*2)+1):
    teta = i*pi/n
    x = a * cos(teta) * (e**(b*teta))
    y = a * sin(teta) * (e**(b*teta))
    z = t*sin(teta/u)
    cor.append([x,y,z])

all_pts = []
crvs = []
for i in range(int(2*v)):
    teta = i*pi/v
    pts = []
    for j in cor:
        x = (j[0]-cor[0][0])*cos(teta) - (j[1]-cor[0][1])*sin(teta) + cor[0][0]
        y = (j[0]-cor[0][0])*sin(teta) + (j[1]-cor[0][1])*cos(teta) + cor[0][1]
        pts.append(rs.AddPoint(x,y,j[2]))
    crvs.append(rs.AddInterpCurve(pts))
    all_pts.append(pts)


surfaces = []

for i in range(-1,int(2*v*p)-1):
    pts1 = all_pts[i][1:]
    pts2 = all_pts[i+1][:-1]
    lines = []
    for j in range(len(pts1)):
        lines.append(rs.AddLine(pts1[j],pts2[j]))
    
    for j in range(len(lines)-1):
        ln1 = lines[j] 
        ln2 = lines[j+1]
        pts_ln2 = rs.DivideCurve(ln2,2)
        srf = rs.AddLoftSrf([ln1,ln2])[0]
        param = rs.SurfaceClosestPoint(srf,pts_ln2[1])
        normal_vector = rs.SurfaceNormal(srf,param)
        rs.MoveObject(pts_ln2[1], m * normal_vector * j / len(lines))
        new_ln2 = rs.AddInterpCurve(pts_ln2)
        surfaces.append(rs.AddLoftSrf([ln1,new_ln2])[0])
# ---------- end python_2 ----------
midpt = CurveMiddle(Curve=python.crvs)

sphere = Sphere(Base=PlaneXY(0, 0, 0), Radius=Slider(0.4, range=0..1))
custom_preview = CustomPreview(Geometry=sphere, Material=ColourSwatch(SwatchColor=RGB(88, 82, 88)))

points = PointList(Points=midpt, Size="2")
surface = Surface(python_2.surfaces)

custom_preview_lineweights = CustomPreviewLineweights(Geometry=surface, Shader=ColourSwatch(SwatchColor=RGB(99, 60, 46)), Thickness=Slider(3.12, range=0..10), Absolute=False)
